# Grasshopper definition gaussian-grouping.gh (Grasshopper 1.0.7)
# plug-ins: LunchBox, LunchBoxML

srf = Surface(<surface referenced from the Rhino model>)
# https://www.youtube.com/watch?v=e6WglyUB-7A&t=772s
quads = QuadPanels(Surface=srf, UDivisions=Slider(20, range=0..50), VDivisions=Slider(21, range=0..50))

# ---- group: perimeter calculation
debrep = DeconstructBrep(Brep=quads)  # -> Faces, Edges, Vertices
join = JoinCurves(Curves=debrep.Edges, Preserve=False)  # -> flatten(Curves)
len = Length(Curve=join)

# ----
area = Area(Geometry=quads)  # -> Area, Centroid
entwine = Entwine(Branch00=area.Area, Branch01=len, FlattenInputs=True)
flip = FlipMatrix(Data=entwine)
panel = Panel(flip)
gaussianmix = GaussianMixture(TrainingInputs=flip, Components=Slider(5, range=0..20), RandomSeed=Slider(46, range=0..100))  # -> Result, Likelihood, Probability
panel_2 = Panel(gaussianmix.Result)
bnd = Bounds(Numbers=gaussianmix.Result)
panel_3 = Panel(bnd)
dedomain = DeconstructDomain(Domain=bnd)  # -> Start, End
gradient = Gradient(
    LowerLimit=dedomain.Start,
    UpperLimit=dedomain.End,
    Parameter=gaussianmix.Result,
    stops=[0: RGB(0, 128, 0), 0.5: RGB(255, 255, 0), 1: RGB(255, 0, 0)])
preview = CustomPreview(Geometry=quads, Material=gradient)
