# Grasshopper definition neural-network.gh (Grasshopper 1.0.7)
# plug-ins: LunchBoxML, Bifocals

# ---- group: Labels
txt = Text(["Phone Booth", "Phone Booth", "Small Office", "Small Office", "Medium Office", "Medium Office", "Large Office", "Large Office", "Conference Room", "Conference Room"])
space_name = Panel(txt)
num = Number([0, 1, 2, 3, 4, 5, 6, 7, 8, 9])
space_index = Panel(num)

# ---- group: Training Data
crv = Curve([<curve referenced from the Rhino model> x10])
bbox = BoundingBox(Content=crv, Plane=PlaneXY(0, 0, 0))  # -> Box, Box_2
debox = DeconstructBox(Box=bbox.Box)  # -> Plane, X, Y, Z
dedomain = DeconstructDomain(Domain=debox.X)  # -> Start, End
dedomain_2 = DeconstructDomain(Domain=debox.Y)  # -> Start, End
area = Area(Geometry=crv)  # -> Area, Centroid
area_2 = Panel(area.Area)
tag = TextTag3D(Location=area.Centroid, Size=1, Justification=7)

# ----
subtraction = Subtraction(A=dedomain.End, B=dedomain.Start)
subtraction_2 = Subtraction(A=dedomain_2.End, B=dedomain_2.Start)

# ---- group: Training Data (continued)
length = Panel(subtraction)
width = Panel(subtraction_2)

# ---- group: Remap Vectors
bnd = Bounds(Numbers=area_2)
bnd_2 = Bounds(Numbers=length)
bnd_3 = Bounds(Numbers=width)
remap = RemapNumbers(Value=area_2, Source=bnd, Target=Domain(0, 1))  # -> Mapped, Clipped
remap_2 = RemapNumbers(Value=length, Source=bnd_2, Target=Domain(0, 1))  # -> Mapped, Clipped
remap_3 = RemapNumbers(Value=width, Source=bnd_3, Target=Domain(0, 1))  # -> Mapped, Clipped
entwine = Entwine(Branch00=remap.Mapped, Branch01=remap_2.Mapped, Branch02=remap_3.Mapped, FlattenInputs=True)
flip = FlipMatrix(Data=entwine)

# ----
neural_network_trainer = NeuralNetworkTrainer(
    TrainingInputs=flip,
    TrainingOutputs=space_index,
    HiddenNeurons=6,
    LearningAlgorithm=2,
    ActivationFunction=0,
    Alpha=2,
    Iterations=500)  # -> TrainedNueralNetwork, ErrorsDynamics
panel = Panel(flip)

# ----
# https://www.youtube.com/watch?v=e6WglyUB-7A&t=772s
crv_2 = Curve(<curve referenced from the Rhino model>)
bbox_2 = BoundingBox(Content=crv_2, Plane=PlaneXY(0, 0, 0))  # -> Box, Box_2
debox_2 = DeconstructBox(Box=bbox_2.Box)  # -> Plane, X, Y, Z
dedomain_3 = DeconstructDomain(Domain=debox_2.X)  # -> Start, End
dedomain_4 = DeconstructDomain(Domain=debox_2.Y)  # -> Start, End
area_3 = Area(Geometry=crv_2)  # -> Area, Centroid
area_4 = Panel(area_3.Area)

subtraction_3 = Subtraction(A=dedomain_3.End, B=dedomain_3.Start)
subtraction_4 = Subtraction(A=dedomain_4.End, B=dedomain_4.Start)

length_2 = Panel(subtraction_3)
width_2 = Panel(subtraction_4)

# ---- group: Remap Vectors
bnd_4 = Bounds(Numbers=area_2)
bnd_5 = Bounds(Numbers=length)
bnd_6 = Bounds(Numbers=width)
remap_4 = RemapNumbers(Value=area_4, Source=bnd_4, Target=Domain(0, 1))  # -> Mapped, Clipped
remap_5 = RemapNumbers(Value=length_2, Source=bnd_5, Target=Domain(0, 1))  # -> Mapped, Clipped
remap_6 = RemapNumbers(Value=width_2, Source=bnd_6, Target=Domain(0, 1))  # -> Mapped, Clipped
entwine_2 = Entwine(Branch00=remap_4.Mapped, Branch01=remap_5.Mapped, Branch02=remap_6.Mapped, FlattenInputs=True)
flip_2 = FlipMatrix(Data=entwine_2)

# ----
panel_2 = Panel(flip_2)

# ---- group: Neural Net
number_slider = Slider(15, range=0..20)
neural = NeuralNetwork(
    TestData=flip_2,
    TraingInputs=flip,
    Labels=space_index,
    HiddenNeurons=5,
    Alpha=2,
    Iterations=number_slider,
    RandomSeed=number_slider)

# ----
neural_network_tester = NeuralNetworkTester(TrainedNeuralNetwork=neural_network_trainer.TrainedNueralNetwork, TestInputData=flip_2)

# ---- group: Visualize Result
item = ListItem(List=space_name, Index=neural, Wrap=True)
panel_3 = Panel(item)
tag_2 = TextTag3D(Location=area_3.Centroid, Text=item, Size=1, Colour=ColourSwatch(SwatchColor=RGB(255, 255, 255)), Justification=7)
