# Grasshopper definition nonlinear-regression.gh (Grasshopper 1.0.7)
# plug-ins: LunchBoxML, Bifocals

pt = Point(<point referenced from the Rhino model>)
pt_2 = Point([<point referenced from the Rhino model> x105])
pdecon = Deconstruct(Point=pt_2)  # -> graft(XComponent), YComponent, ZComponent
pdecon_2 = Deconstruct(Point=pt)  # -> XComponent, YComponent, ZComponent
series = Series(Start=0, Step=7, Count=50)  # -> graft(Series)
nonlinereg = NonlinearRegression(
    TestData=series,
    TrainingInputs=pdecon.XComponent,
    TrainingOutput=pdecon.YComponent,
    Sigma=Slider(37, range=0..50),
    Complexity=100,
    RandomSeed=5)  # -> Result, Score, Error
pt_3 = ConstructPoint(XCoordinate=flatten(series), YCoordinate=nonlinereg.Result, ZCoordinate=0)
panel = Panel(nonlinereg.Result)
intcrv = Interpolate(Vertices=pt_3, Degree=3, Periodic=False, KnotStyle=1)  # -> Curve, Length, Domain
